# Dynamo graph Dy_DeveloperCreateParameters.dyn (Dynamo 2.13.1.3887)

# group: ELABORAÇÃO FUTURA
code_block = CodeBlock()
# ---------- code_block.designscript (43 lines) ----------
/*
"CKT_001_nome",
"CKT_001_configuracao",
"CKT_002_nome",
"CKT_002_configuracao",
"CKT_003_nome",
"CKT_003_configuracao",
"CKT_004_nome",
"CKT_004_configuracao",
"CKT_005_nome",
"CKT_005_configuracao",
"CKT_006_nome",
"CKT_006_configuracao",
"CKT_007_nome",
"CKT_007_configuracao",
"CKT_008_nome",
"CKT_008_configuracao",
"CKT_009_nome",
"CKT_009_configuracao",
"CKT_010_nome",
"CKT_010_configuracao",
"CKT_011_nome",
"CKT_011_configuracao",
"CKT_012_nome",
"CKT_012_configuracao",
"CKT_013_nome",
"CKT_013_configuracao",
"CKT_014_nome",
"CKT_014_configuracao",
"CKT_015_nome",
"CKT_015_configuracao",
"CKT_016_nome",
"CKT_016_configuracao",
"CKT_017_nome",
"CKT_017_configuracao",
"CKT_018_nome",
"CKT_018_configuracao",
"CKT_019_nome",
"CKT_019_configuracao",
"CKT_020_nome",
"CKT_020_configuracao",

*/;
# ----------------------------------------
true_instance_false_type = CodeBlock { true; }
code_block_2 = CodeBlock { "circuit"; }
spec_types = SpecTypes()  # nothing selected
group_types = GroupTypes()  # nothing selected
categories = Categories("OST_CableTray")
categories_2 = Categories("OST_CableTrayFitting")
categories_3 = Categories("OST_Conduit")
categories_4 = Categories("OST_ConduitFitting")
code_block_3 = CodeBlock(a=categories, b=categories_2, c=categories_3, d=categories_4) { a + b + c + d; }
createSharedParameter = Parameter.CreateSharedParameter(groupName=code_block_2, specType=spec_types, groupType=group_types, categoryList=code_block_3)  # unwired: parameterName, instance

# group: PARAMETERS
parameters_name = CodeBlock()
# ---------- parameters_name.designscript (28 lines) ----------
[["ESP_classificacao_nivel_01",
"ESP_classificacao_nivel_02",
"ESP_classificacao_nivel_03",
"ESP_classificacao_nivel_04",
"ESP_classificacao_nivel_05",
"ESP_codigo",
"ESP_discriminacao",
"ESP_descricao_base",
"ESP_unidade",
"ESP_especificacao_geral",
"ESP_referencia_fabricante",
"ESP_notas_gerais",
"ESP_contavel",
"PROJ_subdisciplina",
"PROJ_filtro_grafico",
"PROJ_instalacao",
"PROJ_descricao_comentario"],
["developer_code",
"ITC_schedule",
"ITC_subcategory",
"ITC_dynamo",
"ITC_type_comment",
"ITC_instance_comment",
"ifcExportAs",
"Dy_description",
"Dy_count",
"DATA_compilation",
"DATA_all_compilation"]];
# ----------------------------------------
parameters_caracteristc = CodeBlock()
# ---------- parameters_caracteristc.designscript (30 lines) ----------
[[false,
false,
false,
false,
false,
false,
false,
false,
false,
false,
false,
false,
false,
true,
true,
true,
true],
[false,
false,
false,
false,
false,
true,
true,
true,
true,
true,
true]];
// true = instance
// false = type
# ----------------------------------------

# group: CATEGORIES
bandejas_de_cabos = Categories("OST_CableTray")
conexões_de_bandeja_de_cabos = Categories("OST_CableTrayFitting")
conduites = Categories("OST_Conduit")
conexões_do_conduite = Categories("OST_ConduitFitting")
equipamento_mecânico = Categories("OST_MechanicalEquipment")
code_block_4 = CodeBlock(a=bandejas_de_cabos, b=conexões_de_bandeja_de_cabos, c=conduites, d=conexões_do_conduite, e=equipamento_mecânico) { [a, b, c, d, e]; }

# group: ESPECIFICATION
group_types_engenharia_elétrica = GroupTypes("autodesk.parameter.group:electricalEngineering")
group_types_dados = GroupTypes("autodesk.parameter.group:data")
code_block_5 = CodeBlock(a=group_types_engenharia_elétrica, b=group_types_dados) { [[a],[b]]; }
spec_types_texto = SpecTypes("autodesk.spec:spec.string")

code_block_6 = CodeBlock(parameters_names=parameters_name, parameters_types=parameters_caracteristc, categories=code_block_4, parameter_group=code_block_5, parameter_attribute=spec_types_texto)
# ---------- code_block_6.designscript (23 lines) ----------
/*
Shared parameter already created must be deleted before run
*/
parameters_names;
parameters_types;
categories;
parameter_group;
parameter_attribute;
shared_parameter_group1 = "engineering";
shared_parameter_group2 = "developer";
[Imperative]
{
aux = [];
	for (i in 0..(List.Count(parameters_names[0])-1))
	{
		aux = Parameter.CreateSharedParameter(parameters_names[0][i], shared_parameter_group1, parameter_attribute, parameter_group[0], parameters_types[0][i], categories);
	};
	for (i in 0..(List.Count(parameters_names[1])-1))
	{
		aux = Parameter.CreateSharedParameter(parameters_names[1][i], shared_parameter_group2, parameter_attribute, parameter_group[1], parameters_types[1][i], categories);
	};
	return 0;
};
# ----------------------------------------
