# Dynamo graph Dy_DeveloperCreateParametersPart2.dyn (Dynamo 2.13.1.3887)

# group: PARAMETERS
parameters_name = CodeBlock()
# ---------- parameters_name.designscript (24 lines) ----------
[["ESP2_classificacao_nivel_01",
"ESP2_classificacao_nivel_02",
"ESP2_classificacao_nivel_03",
"ESP2_classificacao_nivel_04",
"ESP2_classificacao_nivel_05",
"ESP2_codigo",
"ESP2_discriminacao",
"ESP2_descricao_base",
"ESP2_unidade",
"ESP2_especificacao_geral",
"ESP2_referencia_fabricante",
"ESP2_notas_gerais",
"ESP2_contavel"],
["developer_code2",
"Dy_description2",
"Dy_count2",
"ITC_schedule2",
"ITC_subcategory2",
"ITC_type_comment2",
"ITC_instance_comment2",
"ITC_dynamo2",
"ITC_quantities2",
"DATA_compilation2",
"DATA_all_compilation2"]];
# ----------------------------------------
parameters_caracteristc = CodeBlock()
# ---------- parameters_caracteristc.designscript (26 lines) ----------
[[false,
false,
false,
false,
false,
false,
false,
false,
false,
false,
false,
false,
false],
[false,
true,
true,
false,
false,
false,
true,
false,
true,
true,
true]];
// true = instance
// false = type
# ----------------------------------------

# group: CATEGORIES
bandejas_de_cabos = Categories("OST_CableTray")
conexões_de_bandeja_de_cabos = Categories("OST_CableTrayFitting")
conduites = Categories("OST_Conduit")
conexões_do_conduite = Categories("OST_ConduitFitting")
code_block = CodeBlock(a=bandejas_de_cabos, b=conexões_de_bandeja_de_cabos, c=conduites, d=conexões_do_conduite) { [a, b, c, d]; }

# group: ESPECIFICATION
group_types_engenharia_elétrica = GroupTypes("autodesk.parameter.group:electricalEngineering")
group_types_dados = GroupTypes("autodesk.parameter.group:data")
code_block_2 = CodeBlock(a=group_types_engenharia_elétrica, b=group_types_dados) { [[a],[b]]; }
spec_types_texto = SpecTypes("autodesk.spec:spec.string")

code_block_3 = CodeBlock(parameters_names=parameters_name, parameters_types=parameters_caracteristc, categories=code_block, parameter_group=code_block_2, parameter_attribute=spec_types_texto)
# ---------- code_block_3.designscript (23 lines) ----------
/*
Shared parameter already created must be deleted before run
*/
parameters_names;
parameters_types;
categories;
parameter_group;
parameter_attribute;
shared_parameter_group1 = "engineering2";
shared_parameter_group2 = "developer2";
[Imperative]
{
aux = [];
	for (i in 0..(List.Count(parameters_names[0])-1))
	{
		aux = Parameter.CreateSharedParameter(parameters_names[0][i], shared_parameter_group1, parameter_attribute, parameter_group[0], parameters_types[0][i], categories);
	};
	for (i in 0..(List.Count(parameters_names[1])-1))
	{
		aux = Parameter.CreateSharedParameter(parameters_names[1][i], shared_parameter_group2, parameter_attribute, parameter_group[1], parameters_types[1][i], categories);
	};
	return 0;
};
# ----------------------------------------
