# Dynamo graph Dy_DeveloperCreateSchedules.dyn "Dy_CreateSchedules" (Dynamo 2.13.1.3887)

code_block = CodeBlock()
# ---------- code_block.designscript (4 lines) ----------
["PLUGIN_Bandeja_De_Cabos_(juncoes_de_segmentos)",
"PLUGIN_Bandeja_De_Cabos_(juncoes_de_conexoes)",
"PLUGIN_Condutos_(juncoes_de_segmentos)",
"PLUGIN_Condutos_(juncoes_de_conexoes)"];
# ----------------------------------------
table_names = CodeBlock()
# ---------- table_names.designscript (7 lines) ----------
["PLUGIN_Bandeja_De_Cabos_(segmentos)",
"PLUGIN_Bandeja_De_Cabos_(conexoes)",
"PLUGIN_Condutos_(segmentos)",
"PLUGIN_Condutos_(conexoes)",
"PLUGIN_Aterramento_(conectores)",
"PLUGIN_Aterramento_(cabos)",
"PLUGIN_Elementos_De_Fixacao_(segmentos)"];
# ----------------------------------------
categories = Categories("OST_MechanicalEquipment")
table_names_2 = CodeBlock { "PLUGIN_Aterramento_Conexoes"; }
schedule_type = ScheduleTypes("RegularSchedule")
code_block_2 = CodeBlock()
# ---------- code_block_2.designscript (10 lines) ----------
["ID_codigo",
"ID_descricao",
"ID_unidade",
"ESP_codigo",
"ESP_discriminacao",
"ESP_especificacao_geral",
"ESP_notas_gerais",
"ESP_referencia_fabricante",
"ESP_contavel",
"ITC_schedule"];
# ----------------------------------------
code_block_3 = CodeBlock { 7; }
schedule_filter_type = ScheduleFilterType("Equal")
code_block_4 = CodeBlock(category=categories, name=table_names_2, schedule_type=schedule_type, fields_names=code_block_2, filter_column_number=code_block_3, schedule_filter_type=schedule_filter_type)
# ---------- code_block_4.designscript (23 lines) ----------
//--------------------------< part I - create schedule >----------------------------
//create schedule
schedule = ScheduleView.CreateSchedule(category, name, schedule_type);


//----------------------------< part II - add fields >------------------------------
//able fields and able fields names (string)
able_fields = ScheduleView.SchedulableFields(schedule);
able_fileds_names = SchedulableField.Name(able_fields);

//add fileds according to fields name
add_fields = ScheduleView.AddFields(schedule, Get.ValueAtIndex(able_fields, List.IndexOf(able_fileds_names, fields_names)));


//----------------------------< part III - filter >----------------------------------
//seleciona o field responsable to filter
filter_field = Get.ValueAtIndex(ScheduleView.Fields(add_fields), filter_column_number);

//set filter
set_filter = ScheduleFilter.ByFieldTypeAndValue(filter_field, schedule_filter_type, name);

//add filter
add_filter = ScheduleView.AddFilters(schedule, set_filter);
# ----------------------------------------
