# Dynamo graph Dy_DeveloperDatabaseAll.dyn (Dynamo 2.13.1.3887)

# group: STUDY
now = DateTime.Now()
format = DateTime.Format(dateTime=now)
writeText = FileSystem.WriteText()  # unwired: filePath, text
writeToFile = Image.WriteToFile()  # unwired: path, image

# group: ELEMENTS TYPES SELECTED
equipamento_mecânico = Categories("OST_MechanicalEquipment")
all_elements_of_category = ElementsOfCategory(Category=equipamento_mecânico)
categories = Categories("OST_ConduitFitting")
all_elements_of_category_2 = ElementsOfCategory(Category=categories)
categories_2 = Categories("OST_Conduit")
all_elements_of_category_3 = ElementsOfCategory(Category=categories_2)
categories_3 = Categories("OST_CableTrayFitting")
all_elements_of_category_4 = ElementsOfCategory(Category=categories_3)
categories_4 = Categories("OST_CableTray")
all_elements_of_category_5 = ElementsOfCategory(Category=categories_4)
put_together = CodeBlock(a=all_elements_of_category, b=all_elements_of_category_2, c=all_elements_of_category_3, d=all_elements_of_category_4, e=all_elements_of_category_5) { [a, b, c, d, e]; }

# group: DATABASE
file_path = Filename("..\..\..\08-BANCO DE DADOS\TXT\datacenter_eletrica8.txt")
file_from_path = FileObject(path=file_path)
end_of_the_row_read = StringInput(";||")
end_of_the_row_assigned = StringInput("||")
parameter_splitter = StringInput(";|;")
manipulate_datas_from_database = CodeBlock(data=file_from_path, aux1=end_of_the_row_read, aux2=end_of_the_row_assigned, divider=parameter_splitter)
# ---------- manipulate_datas_from_database.designscript (15 lines) ----------
read = FileSystem.ReadText(data);
aux1;
aux2;
txt_aux1 = String.Replace(read, aux1, aux2);
sections = String.Split(txt_aux1, ["||"]);
parameter_name = String.Split(Dictionary.ValueAtKey(List.Deconstruct(sections), "first"), [divider]);
parameter_value = List.Transpose(String.Split(Dictionary.ValueAtKey(List.Deconstruct(sections), "rest"), [divider]));
[Imperative]
{
	for (i in 0..(List.Count(parameter_value[0])-1))
	{
		parameter_value[0][i] = String.Remove(parameter_value[0][i], 0, 2);
	};
		return parameter_value;
};
# ----------------------------------------

write_informations_from_data = CodeBlock(elements=put_together, parameter_name=manipulate_datas_from_database.out5, parameter_value=manipulate_datas_from_database.out7)  # "WRITE INFORMATIONS FROM DATA BASE IN ELEMENTS"
# ---------- write_informations_from_data.designscript (21 lines) ----------
elements;
parameter_name;
parameter_value;
aux1 = Elements.Element.Name(elements);
aux2 = ElementType.ByName(aux1);

[Imperative]
{
//j=coluna do banco de dados
//i=instância da lista de elementos
	for (j in 1..(List.Count(parameter_name)-1))
	{
		for (i in 0..(List.Count(elements)-1))
		{
			dictionary_aux = Dictionary.ByKeysValues(parameter_value[0], parameter_value[j]);
			dictionary_out = Dictionary.ValueAtKey(dictionary_aux, aux1[i]);
			element1 = Elements.Element.SetParameterByName(aux2[i], parameter_name[j], dictionary_out);
		};
	};
		return 0;
};
# ----------------------------------------
