# Dynamo graph Dy_PlanilhaAterramento.dyn (Dynamo 2.13.1.3887)

nome_da_família = CodeBlock { "FIX_CONECTOR TERMINAL DE APERTO MECÂNICO - VERTICAL"; }
nome_do_tipo = CodeBlock { "Conector terminal de pressão - 16mm²"; }
byFamilyNameAndTypeName = FamilyType.ByFamilyNameAndTypeName(familyName=nome_da_família, typeName=nome_do_tipo)
nome_do_tipo_2 = CodeBlock { "Conector terminal de pressão - 35mm²"; }
byFamilyNameAndTypeName_2 = FamilyType.ByFamilyNameAndTypeName(familyName=nome_da_família, typeName=nome_do_tipo_2)
nome_do_tipo_3 = CodeBlock { "Conector terminal de pressão - 50mm²"; }
byFamilyNameAndTypeName_3 = FamilyType.ByFamilyNameAndTypeName(familyName=nome_da_família, typeName=nome_do_tipo_3)
agrupa_os_tipos = CodeBlock(A=byFamilyNameAndTypeName, B=byFamilyNameAndTypeName_2, C=byFamilyNameAndTypeName_3) { [A,B,C]; }
nome_da_família_2 = CodeBlock { "FIX_CONECTOR ATERRAMENTO BANDEJA"; }
nome_do_tipo_4 = CodeBlock { "Conector tipo parafuso fendido - 16mm²"; }
byFamilyNameAndTypeName_4 = FamilyType.ByFamilyNameAndTypeName(familyName=nome_da_família_2, typeName=nome_do_tipo_4)
nome_do_tipo_5 = CodeBlock { "Conector tipo parafuso fendido - 35mm²"; }
byFamilyNameAndTypeName_5 = FamilyType.ByFamilyNameAndTypeName(familyName=nome_da_família_2, typeName=nome_do_tipo_5)
nome_do_tipo_6 = CodeBlock { "Conector tipo parafuso fendido - 50mm²"; }
byFamilyNameAndTypeName_6 = FamilyType.ByFamilyNameAndTypeName(familyName=nome_da_família_2, typeName=nome_do_tipo_6)
agrupa_os_tipos_2 = CodeBlock(A=byFamilyNameAndTypeName_4, B=byFamilyNameAndTypeName_5, C=byFamilyNameAndTypeName_6) { [A,B,C]; }
nome_da_família_3 = CodeBlock { "FIX_CONECTOR TERMINAL DE PRESSÃO - HORIZONTAL"; }
nome_do_tipo_7 = CodeBlock { "Conector terminal de pressão - 16mm²"; }
byFamilyNameAndTypeName_7 = FamilyType.ByFamilyNameAndTypeName(familyName=nome_da_família_3, typeName=nome_do_tipo_7)
nome_do_tipo_8 = CodeBlock { "Conector terminal de pressão - 35mm²"; }
byFamilyNameAndTypeName_8 = FamilyType.ByFamilyNameAndTypeName(familyName=nome_da_família_3, typeName=nome_do_tipo_8)
nome_do_tipo_9 = CodeBlock { "Conector terminal de pressão - 50mm²"; }
byFamilyNameAndTypeName_9 = FamilyType.ByFamilyNameAndTypeName(familyName=nome_da_família_3, typeName=nome_do_tipo_9)
agrupa_os_tipos_3 = CodeBlock(A=byFamilyNameAndTypeName_7, B=byFamilyNameAndTypeName_8, C=byFamilyNameAndTypeName_9) { [A,B,C]; }
nome_da_família_4 = CodeBlock { "FIX_CONECTOR TERMINAL DE PRESSÃO - VERTICAL"; }
nome_do_tipo_10 = CodeBlock { "Conector terminal de pressão - 16mm²"; }
byFamilyNameAndTypeName_10 = FamilyType.ByFamilyNameAndTypeName(familyName=nome_da_família_4, typeName=nome_do_tipo_10)
nome_do_tipo_11 = CodeBlock { "Conector terminal de pressão - 35mm²"; }
byFamilyNameAndTypeName_11 = FamilyType.ByFamilyNameAndTypeName(familyName=nome_da_família_4, typeName=nome_do_tipo_11)
nome_do_tipo_12 = CodeBlock { "Conector terminal de pressão - 50mm²"; }
byFamilyNameAndTypeName_12 = FamilyType.ByFamilyNameAndTypeName(familyName=nome_da_família_4, typeName=nome_do_tipo_12)
agrupa_os_tipos_4 = CodeBlock(A=byFamilyNameAndTypeName_10, B=byFamilyNameAndTypeName_11, C=byFamilyNameAndTypeName_12) { [A,B,C]; }
nome_da_família_5 = CodeBlock { "FIX_PRESILHA COM FURO PARA CABO DE COBRE"; }
nome_do_tipo_13 = CodeBlock { "PRESILHA TIPO U EM COBRE - 16/25mm²"; }
byFamilyNameAndTypeName_13 = FamilyType.ByFamilyNameAndTypeName(familyName=nome_da_família_5, typeName=nome_do_tipo_13)
nome_do_tipo_14 = CodeBlock { "PRESILHA TIPO U EM COBRE - 35/50mm²"; }
byFamilyNameAndTypeName_14 = FamilyType.ByFamilyNameAndTypeName(familyName=nome_da_família_5, typeName=nome_do_tipo_14)
agrupa_os_tipos_5 = CodeBlock(A=byFamilyNameAndTypeName_13, B=byFamilyNameAndTypeName_14) { [A,B]; }
nome_da_família_6 = CodeBlock { "FIX_CONECTOR IRREVERSÍVEL À COMPRESSÃO CABO CABO PARALELO"; }
nome_do_tipo_15 = CodeBlock { "CONECTOR IRREVERSÍVEL CABO CABO PARALELO - 16mm² / 16mm²"; }
byFamilyNameAndTypeName_15 = FamilyType.ByFamilyNameAndTypeName(familyName=nome_da_família_6, typeName=nome_do_tipo_15)
nome_do_tipo_16 = CodeBlock { "CONECTOR IRREVERSÍVEL CABO CABO PARALELO - 16mm² / 35mm²"; }
byFamilyNameAndTypeName_16 = FamilyType.ByFamilyNameAndTypeName(familyName=nome_da_família_6, typeName=nome_do_tipo_16)
nome_do_tipo_17 = CodeBlock { "CONECTOR IRREVERSÍVEL CABO CABO PARALELO - 16mm² / 50mm²"; }
byFamilyNameAndTypeName_17 = FamilyType.ByFamilyNameAndTypeName(familyName=nome_da_família_6, typeName=nome_do_tipo_17)
nome_do_tipo_18 = CodeBlock { "CONECTOR IRREVERSÍVEL CABO CABO PARALELO - 35mm² / 35mm²"; }
byFamilyNameAndTypeName_18 = FamilyType.ByFamilyNameAndTypeName(familyName=nome_da_família_6, typeName=nome_do_tipo_18)
nome_do_tipo_19 = CodeBlock { "CONECTOR IRREVERSÍVEL CABO CABO PARALELO - 35mm² / 50mm²"; }
byFamilyNameAndTypeName_19 = FamilyType.ByFamilyNameAndTypeName(familyName=nome_da_família_6, typeName=nome_do_tipo_19)
nome_do_tipo_20 = CodeBlock { "CONECTOR IRREVERSÍVEL CABO CABO PARALELO - 50mm² / 50mm²"; }
byFamilyNameAndTypeName_20 = FamilyType.ByFamilyNameAndTypeName(familyName=nome_da_família_6, typeName=nome_do_tipo_20)
agrupa_os_tipos_6 = CodeBlock(A=byFamilyNameAndTypeName_15, B=byFamilyNameAndTypeName_16, C=byFamilyNameAndTypeName_17, D=byFamilyNameAndTypeName_18, E=byFamilyNameAndTypeName_19, F=byFamilyNameAndTypeName_20) { [A,B,C,D,E,F]; }
agrupa_os_tipos_7 = CodeBlock(A=agrupa_os_tipos, B=agrupa_os_tipos_2, C=agrupa_os_tipos_3, D=agrupa_os_tipos_4, E=agrupa_os_tipos_5, F=agrupa_os_tipos_6) { [A,B,C,D,E,F]; }
all_elements_of_family_type = ElementsOfFamilyType(Family_Type=agrupa_os_tipos_7)
descricao_planilha_de = CodeBlock(elementos=all_elements_of_family_type)  # "Descricao Planilha de Qunatidades"
# ---------- descricao_planilha_de.designscript (5 lines) ----------
elementos_tipo = Elements.Element.ElementType(elementos);
descricao_base = Elements.Element.GetParameterValueByName(elementos_tipo, "ID_Descrição");
comentario_tipo = Elements.Element.GetParameterValueByName(elementos_tipo, "ID_Comentário Tipo");
aux = ((descricao_base + " - ") + comentario_tipo);
out = Elements.Element.SetParameterByName(elementos, "ID_Descrição Planilha Quantidades", aux);
# ----------------------------------------
código = CodeBlock(elementos=all_elements_of_family_type)
# ---------- código.designscript (6 lines) ----------
elementos_tipo = Elements.Element.ElementType(elementos);
aux1 = Elements.Element.GetParameterValueByName(elementos_tipo, "ID_Código EAP");
aux2 = Elements.Element.GetParameterValueByName(elementos, "ID_Código Sufixo");
aux3 = ((aux2 != "" ? ("." + aux2) : ""));
codigo = (aux1 + aux3);
out = Elements.Element.SetParameterByName(elementos, "ID_Código", codigo);
# ----------------------------------------
categories = Categories("OST_Conduit")
all_elements_of_category = ElementsOfCategory(Category=categories)
descricao_planilha_de_2 = CodeBlock(elementos=all_elements_of_category)  # "Descricao Planilha de Qunatidades"
# ---------- descricao_planilha_de_2.designscript (23 lines) ----------
elementos_tipo = Elements.Element.ElementType(elementos);
categoria = Elements.Element.GetParameterValueByName(elementos_tipo, "ITC_Dynamo");
[Imperative]
{
	for (i in 0..(List.Count(categoria)-1))
	{
		if (categoria[i] == "Aterramento")
		{
			descricao_base = Elements.Element.GetParameterValueByName(elementos_tipo[i], "ID_Descrição");
			aux1 = Elements.Element.GetParameterValueByName(elementos[i], "Tamanho");
			aux2 = Elements.Element.GetParameterValueByName(elementos[i], "ITC_Instalação");
			out1 = ((aux1 == "16ø" ? "16 mm²" : (aux1 == "35ø" ? "35 mm²" : (aux1 == "50ø" ? "50 mm²" : "ERROR verificar seção"))));
			out2 = ((aux2 == "" ? "." : " - " + aux2));
			descricao = ((descricao_base + " - ") + out1) + out2;
			out = Elements.Element.SetParameterByName(elementos[i], "ID_Descrição Planilha Quantidades", descricao);
		}
		else
		{
			continue;
		}
	};
	return 0;
};
# ----------------------------------------
código_2 = CodeBlock(elementos=all_elements_of_category)
# ---------- código_2.designscript (22 lines) ----------
elementos_tipo = Elements.Element.ElementType(elementos);
categoria = Elements.Element.GetParameterValueByName(elementos_tipo, "ITC_Dynamo");
[Imperative]
{
	for (i in 0..(List.Count(categoria)-1))
	{
		if (categoria[i] == "Aterramento")
		{
			codigo_eap = Elements.Element.GetParameterValueByName(elementos_tipo[i], "ID_Código EAP");
			codigo_sufixo = Elements.Element.GetParameterValueByName(elementos[i], "ID_Código Sufixo");
			aux1 = codigo_eap;
			aux2 = ((codigo_sufixo != "" ? ("." + codigo_sufixo) : ""));
			codigo = (aux1 + aux2);
			out = Elements.Element.SetParameterByName(elementos[i], "ID_Código", codigo);
		}
		else
		{
			continue;
		}
	};
	return 0;
};
# ----------------------------------------
description = CodeBlock()
# ---------- description.designscript (20 lines) ----------
/*

preenche:

- ID_Descrição Planilha Quantidades
- ID_Código

dos itens abaixo:

- FIX_CONECTOR TERMINAL DE APERTO MECÂNICO - VERTICAL
- FIX_CONECTOR ATERRAMENTO BANDEJA
- FIX_CONECTOR TERMINAL DE PRESSÃO - HORIZONTAL
- FIX_CONECTOR TERMINAL DE PRESSÃO - VERTICAL
- FIX_PRESILHA COM FURO PARA CABO DE COBRE
- FIX_CONECTOR IRREVERSÍVEL À COMPRESSÃO CABO CABO PARALELO

- ELE - CABO DE COBRE NU
- ELE - CABO UNIPOLAR ISOLADO 750V

*/;
# ----------------------------------------
