# Dynamo graph Dy_PlanilhaBusway.dyn (Dynamo 2.13.1.3887)

# group: Bandeja
categories = Categories("OST_CableTray")
all_elements_of_category = ElementsOfCategory(Category=categories)
código = CodeBlock(elementos=all_elements_of_category)
# ---------- código.designscript (21 lines) ----------
elementos_tipo = Elements.Element.ElementType(elementos);
rotina = Elements.Element.GetParameterValueByName(elementos_tipo, "ITC_Dynamo");
[Imperative]
{
	for (i in 0..(List.Count(rotina)-1))
	{
		if (rotina[i] == "Dy_PlanilhaBusway")
		{
			codigo_eap = Elements.Element.GetParameterValueByName(elementos_tipo[i], "ID_Código EAP");
			sufixo = Elements.Element.GetParameterValueByName(elementos[i], "ID_Código Sufixo");
			aux1 = ((sufixo != "" ? ("." + sufixo) : ""));
			codigo = (codigo_eap + aux1);
			out = Elements.Element.SetParameterByName(elementos[i], "ID_Código", codigo);
		}
		else
		{
			continue;
		}
	};
	return 0;
};
# ----------------------------------------
descricao_planilha_de = CodeBlock(elementos=all_elements_of_category)  # "Descricao Planilha de Qunatidades"
# ---------- descricao_planilha_de.designscript (28 lines) ----------
elementos_tipo = Elements.Element.ElementType(elementos);
rotina = Elements.Element.GetParameterValueByName(elementos_tipo, "ITC_Dynamo");
[Imperative]
{
	for (i in 0..(List.Count(rotina)-1))
	{
		if (rotina[i] == "Dy_PlanilhaBusway")
		{
			descricao_base = Elements.Element.GetParameterValueByName(elementos_tipo[i], "ID_Descrição");
			//largura = Elements.Element.GetParameterValueByName(elementos[i], "Largura");
			//altura = Elements.Element.GetParameterValueByName(elementos[i], "Altura");
			capacidade = Elements.Element.GetParameterValueByName(elementos[i], "PROJ_Capacidade Busway");
			instalacao = Elements.Element.GetParameterValueByName(elementos[i], "ITC_Instalação");
			//aux5 = ((largura == 25 || largura == 0.025 ? 19 : (largura == 38 || largura == 0.038 ? 38 : (largura == 50 || largura == 0.05 ? 50 : (largura == 75 || largura == 0.075 ? 75 : (largura == 100 || largura == 0.1 ? 100 : (largura == 125 || largura == 0.125 ? 125 : (largura == 150 || largura == 0.15 ? 150 : (largura == 175 || largura == 0.175 ? 175 : (largura == 200 || largura == 0.2 ? 200 : (largura == 250 || largura == 0.25 ? 250 : (largura == 300 || largura == 0.3 ? 300 : (largura == 400 || largura == 0.4 ? 400 : (largura == 500 || largura == 0.5 ? 500 : (largura == 600 || largura == 0.6 ? 600 : (largura == 700 || largura == 0.7 ? 700 : (largura == 800 || largura == 0.8 ? 800 : (largura == 900 || largura == 0.9 ? 900 : (largura == 1000 || largura == 1 ? 1000 : "")))))))))))))))))));
			//aux6 = ((altura == 25 || altura == 0.025 ? 19 : (altura == 38 || altura == 0.038 ? 38 : (altura == 50 || altura == 0.05 ? 50 : (altura == 75 || altura == 0.075 ? 75 : (altura == 100 || altura == 0.1 ? 100 : (altura == 125 || altura == 0.125 ? 125 : (altura == 150 || altura == 0.15 ? 150 : (altura == 175 || altura == 0.175 ? 175 : (altura == 200 || altura == 0.2 ? 200 : (altura == 250 || altura == 0.25 ? 250 : (altura == 300 || altura == 0.3 ? 300 : (altura == 400 || altura == 0.4 ? 400 : (altura == 500 || altura == 0.5 ? 500 : (altura == 600 || altura == 0.6 ? 600 : (altura == 700 || altura == 0.7 ? 700 : (altura == 800 || altura == 0.8 ? 800 : (altura == 900 || altura == 0.9 ? 900 : (altura == 1000 || altura == 1 ? 1000 : "")))))))))))))))))));
			//out1 = ((((" - " + aux5) + "x") + aux6) + " mm");
			out1 = (capacidade != "" ? (" - " + capacidade) : "");
			out2 = (instalacao != "" ? (" - " + instalacao) : "");
			descricao = (((descricao_base) + out1) + out2) + ".";
			out = Elements.Element.SetParameterByName(elementos[i], "ID_Descrição Planilha Quantidades", descricao);
		}
		else
		{
			continue;
		}
	};
	return 0;
};
# ----------------------------------------

# group: Conexões de Bandeja
categories_2 = Categories("OST_CableTrayFitting")
all_elements_of_category_2 = ElementsOfCategory()  # unwired: Category
descricao_planilha_de_2 = CodeBlock(elementos=all_elements_of_category_2)  # "Descricao Planilha de Qunatidades (falta limpar código)"
# ---------- descricao_planilha_de_2.designscript (43 lines) ----------
elementos_tipo = Elements.Element.ElementType(elementos);
rotina = Elements.Element.GetParameterValueByName(elementos_tipo, "ITC_Dynamo");
[Imperative]
{
	for (i in 0..(List.Count(rotina)-1))
	{
		if (rotina[i] == "Dy_PlanilhaBusway")
		{
			descricao_base = Elements.Element.GetParameterValueByName(elementos_tipo[i], "ID_Descrição");
			//categoria = Elements.Element.GetParameterValueByName(elementos_tipo[i], "ITC_Subcategoria");
			aux01 = Elements.Element.GetParameterValueByName(elementos[i], "Tray Width");
			aux02 = Elements.Element.GetParameterValueByName(elementos[i], "Tray Height");
			aux03 = Elements.Element.GetParameterValueByName(elementos[i], "Largura");
			aux04 = Elements.Element.GetParameterValueByName(elementos[i], "Altura");
			aux1 = (aux01 == "" ? aux03 : aux01);
			aux2 = (aux02 == "" ? aux04 : aux02);
			aux3 = Elements.Element.GetParameterValueByName(elementos[i], "Largura maior");
			aux4 = Elements.Element.GetParameterValueByName(elementos[i], "Largura menor");
			//aux5 = Elements.Element.GetParameterValueByName(elementos[i], "PROJ_Capacidade Busway");
			aux6 = Elements.Element.GetParameterValueByName(elementos[i], "Ângulo");
			aux7 = Elements.Element.GetParameterValueByName(elementos[i], "PROJ_Instalação");

			aux8 = ((aux1 == 25 || aux1 == 0.025 ? 19 : (aux1 == 38 || aux1 == 0.038 ? 38 : (aux1 == 50 || aux1 == 0.05 ? 50 : (aux1 == 75 || aux1 == 0.075 ? 75 : (aux1 == 100 || aux1 == 0.1 ? 100 : (aux1 == 125 || aux1 == 0.125 ? 125 : (aux1 == 150 || aux1 == 0.15 ? 150 : (aux1 == 175 || aux1 == 0.175 ? 175 : (aux1 == 200 || aux1 == 0.2 ? 200 : (aux1 == 250 || aux1 == 0.25 ? 250 : (aux1 == 300 || aux1 == 0.3 ? 300 : (aux1 == 400 || aux1 == 0.4 ? 400 : (aux1 == 500 || aux1 == 0.5 ? 500 : (aux1 == 600 || aux1 == 0.6 ? 600 : (aux1 == 700 || aux1 == 0.7 ? 700 : (aux1 == 800 || aux1 == 0.8 ? 800 : (aux1 == 900 || aux1 == 0.9 ? 900 : (aux1 == 1000 || aux1 == 1 ? 1000 : "")))))))))))))))))));
			aux9 = ((aux2 == 25 || aux2 == 0.025 ? 19 : (aux2 == 38 || aux2 == 0.038 ? 38 : (aux2 == 50 || aux2 == 0.05 ? 50 : (aux2 == 75 || aux2 == 0.075 ? 75 : (aux2 == 100 || aux2 == 0.1 ? 100 : (aux2 == 125 || aux2 == 0.125 ? 125 : (aux2 == 150 || aux2 == 0.15 ? 150 : (aux2 == 175 || aux2 == 0.175 ? 175 : (aux2 == 200 || aux2 == 0.2 ? 200 : (aux2 == 250 || aux2 == 0.25 ? 250 : (aux2 == 300 || aux2 == 0.3 ? 300 : (aux2 == 400 || aux2 == 0.4 ? 400 : (aux2 == 500 || aux2 == 0.5 ? 500 : (aux2 == 600 || aux2 == 0.6 ? 600 : (aux2 == 700 || aux2 == 0.7 ? 700 : (aux2 == 800 || aux2 == 0.8 ? 800 : (aux2 == 900 || aux2 == 0.9 ? 900 : (aux2 == 1000 || aux2 == 1 ? 1000 : "")))))))))))))))))));

			aux10 = ((aux3 == 25 || aux3 == 0.025 ? 19 : (aux3 == 38 || aux3 == 0.038 ? 38 : (aux3 == 50 || aux3 == 0.05 ? 50 : (aux3 == 75 || aux3 == 0.075 ? 75 : (aux3 == 100 || aux3 == 0.1 ? 100 : (aux3 == 125 || aux3 == 0.125 ? 125 : (aux3 == 150 || aux3 == 0.15 ? 150 : (aux3 == 175 || aux3 == 0.175 ? 175 : (aux3 == 200 || aux3 == 0.2 ? 200 : (aux3 == 250 || aux3 == 0.25 ? 250 : (aux3 == 300 || aux3 == 0.3 ? 300 : (aux3 == 400 || aux3 == 0.4 ? 400 : (aux3 == 500 || aux3 == 0.5 ? 500 : (aux3 == 600 || aux3 == 0.6 ? 600 : (aux3 == 700 || aux3 == 0.7 ? 700 : (aux3 == 800 || aux3 == 0.8 ? 800 : (aux3 == 900 || aux3 == 0.9 ? 900 : (aux3 == 1000 || aux3 == 1 ? 1000 : "")))))))))))))))))));
			aux11 = ((aux4 == 25 || aux4 == 0.025 ? 19 : (aux4 == 38 || aux4 == 0.038 ? 38 : (aux4 == 50 || aux4 == 0.05 ? 50 : (aux4 == 75 || aux4 == 0.075 ? 75 : (aux4 == 100 || aux4 == 0.1 ? 100 : (aux4 == 125 || aux4 == 0.125 ? 125 : (aux4 == 150 || aux4 == 0.15 ? 150 : (aux4 == 175 || aux4 == 0.175 ? 175 : (aux4 == 200 || aux4 == 0.2 ? 200 : (aux4 == 250 || aux4 == 0.25 ? 250 : (aux4 == 300 || aux4 == 0.3 ? 300 : (aux4 == 400 || aux4 == 0.4 ? 400 : (aux4 == 500 || aux4 == 0.5 ? 500 : (aux4 == 600 || aux4 == 0.6 ? 600 : (aux4 == 700 || aux4 == 0.7 ? 700 : (aux4 == 800 || aux4 == 0.8 ? 800 : (aux4 == 900 || aux4 == 0.9 ? 900 : (aux4 == 1000 || aux4 == 1 ? 1000 : "")))))))))))))))))));

			//out1 = (categoria == "Acessórios para Busway" ? (" - " + aux5) : "");
			out1 = (((aux6 > 89) && (aux6 < 91) ? " - 90°" : ((aux6 > 44) && (aux6 < 46) ? " - 45°" : "")));
			//out2 = (categoria == "Acessórios para Busway" ? "" : (aux10 > 0 ? " - " + aux10 + "x" + aux9 + " mm para " + aux11 + "x" + aux9 + " mm." : " - " + aux8 + "x" + aux9 + " mm."));
			out2 = (aux10 > 0 ? " - " + aux10 + "x" + aux9 + " mm para " + aux11 + "x" + aux9 + " mm." : " - " + aux8 + "x" + aux9 + " mm.");
			out3 = (aux7 != "" ? (" - " + aux7 + ".") : "");
			descricao = ((descricao_base + out1) + out2) + out3;
			out = Elements.Element.SetParameterByName(elementos[i], "ID_Descrição Planilha Quantidades", descricao);
		}
		else
		{
			continue;
		}
	};
	return 0;
};
# ----------------------------------------
código_2 = CodeBlock(elementos=all_elements_of_category_2)  # same code as código

# group: Junta para Bandeja
all_elements_of_category_3 = ElementsOfCategory()  # unwired: Category
código_3 = CodeBlock(elementos=all_elements_of_category_3)
# ---------- código_3.designscript (21 lines) ----------
elementos_tipo = Elements.Element.ElementType(elementos);
rotina = Elements.Element.GetParameterValueByName(elementos_tipo, "ITC_Dynamo");
[Imperative]
{
	for (i in 0..(List.Count(rotina)-1))
	{
		if (rotina[i] == "Dy_PlanilhaBusway")
		{
			codigo_eap = Elements.Element.GetParameterValueByName(elementos_tipo[i], "ID2_Código EAP");
			sufixo = Elements.Element.GetParameterValueByName(elementos[i], "ID2_Código Sufixo");
			aux1 = ((sufixo != "" ? ("." + sufixo) : ""));
			codigo = (codigo_eap + aux1);
			out = Elements.Element.SetParameterByName(elementos[i], "ID2_Código", codigo);
		}
		else
		{
			continue;
		}
	};
	return 0;
};
# ----------------------------------------
categories_3 = Categories("OST_CableTray")
descricao_planilha_de_3 = CodeBlock(elementos=all_elements_of_category_3)  # "Descricao Planilha de Qunatidades"
# ---------- descricao_planilha_de_3.designscript (30 lines) ----------
elementos_tipo = Elements.Element.ElementType(elementos);
rotina = Elements.Element.GetParameterValueByName(elementos_tipo, "ITC_Dynamo");
[Imperative]
{
	for (i in 0..(List.Count(rotina)-1))
	{
		if (rotina[i] == "Dy_PlanilhaBusway")
		{
			descricao_base = Elements.Element.GetParameterValueByName(elementos_tipo[i], "ID2_Descrição");
			largura = Elements.Element.GetParameterValueByName(elementos[i], "Largura");
			altura = Elements.Element.GetParameterValueByName(elementos[i], "Altura");
			subcategoria = Elements.Element.GetParameterValueByName(elementos[i], "ITC_Subcategoria");
			//aux1 = Elements.Element.GetParameterValueByName(elementos[i], "PROJ_Capacidade Busway");
			instalacao = Elements.Element.GetParameterValueByName(elementos[i], "PROJ_Instalação");

			aux1 = ((largura == 25 || largura == 0.025 ? 19 : (largura == 38 || largura == 0.038 ? 38 : (largura == 50 || largura == 0.05 ? 50 : (largura == 75 || largura == 0.075 ? 75 : (largura == 100 || largura == 0.1 ? 100 : (largura == 125 || largura == 0.125 ? 125 : (largura == 150 || largura == 0.15 ? 150 : (largura == 175 || largura == 0.175 ? 175 : (largura == 200 || largura == 0.2 ? 200 : (largura == 250 || largura == 0.25 ? 250 : (largura == 300 || largura == 0.3 ? 300 : (largura == 400 || largura == 0.4 ? 400 : (largura == 500 || largura == 0.5 ? 500 : (largura == 600 || largura == 0.6 ? 600 : (largura == 700 || largura == 0.7 ? 700 : (largura == 800 || largura == 0.8 ? 800 : (largura == 900 || largura == 0.9 ? 900 : (largura == 1000 || largura == 1 ? 1000 : "")))))))))))))))))));
			aux2 = ((altura == 25 || altura == 0.025 ? 19 : (altura == 38 || altura == 0.038 ? 38 : (altura == 50 || altura == 0.05 ? 50 : (altura == 75 || altura == 0.075 ? 75 : (altura == 100 || altura == 0.1 ? 100 : (altura == 125 || altura == 0.125 ? 125 : (altura == 150 || altura == 0.15 ? 150 : (altura == 175 || altura == 0.175 ? 175 : (altura == 200 || altura == 0.2 ? 200 : (altura == 250 || altura == 0.25 ? 250 : (altura == 300 || altura == 0.3 ? 300 : (altura == 400 || altura == 0.4 ? 400 : (altura == 500 || altura == 0.5 ? 500 : (altura == 600 || altura == 0.6 ? 600 : (altura == 700 || altura == 0.7 ? 700 : (altura == 800 || altura == 0.8 ? 800 : (altura == 900 || altura == 0.9 ? 900 : (altura == 1000 || altura == 1 ? 1000 : "")))))))))))))))))));

			out1 = (subcategoria == "Perfilado" || subcategoria == "Perfilado_Estrado" ? ((((" - " + aux1) + "x") + aux2) + " mm") : (((" - ") + aux2) + " mm"));
			out2 = (instalacao != "" ? (" - " + instalacao) : "");
			descricao = (((descricao_base) + out1) + out2) + ".";
			out = Elements.Element.SetParameterByName(elementos[i], "ID2_Descrição Planilha Quantidades", descricao);
		}
		else
		{
			continue;
		}
	};
	return 0;
};
# ----------------------------------------

# group: Junta para Conexões de Bandeja
categories_4 = Categories("OST_CableTrayFitting")
all_elements_of_category_4 = ElementsOfCategory()  # unwired: Category
code_block = CodeBlock(elementos=all_elements_of_category_4)
# ---------- code_block.designscript (35 lines) ----------
elementos_tipo = Elements.Element.ElementType(elementos);
rotina = Elements.Element.GetParameterValueByName(elementos_tipo, "ITC_Dynamo");
[Imperative]
{
	for (i in 0..(List.Count(rotina)-1))
	{
		if (rotina[i] == "Dy_PlanilhaBusway")
		{
			descricao_base = Elements.Element.GetParameterValueByName(elementos_tipo[i], "ID2_Descrição");
			subcategoria = Elements.Element.GetParameterValueByName(elementos[i], "ITC_Subcategoria");
			instalacao = Elements.Element.GetParameterValueByName(elementos[i], "PROJ_Instalação");
			aux1 = Elements.Element.GetParameterValueByName(elementos[i], "Largura");
			aux2 = Elements.Element.GetParameterValueByName(elementos[i], "Altura");
			aux5 = ((aux1 == 25 ? 19 : (aux1 == 38 ? 38 : (aux1 == 50 ? 50 : (aux1 == 75 ? 75 : (aux1 == 100 ? 100 : (aux1 == 125 ? 125 : (aux1 == 150 ? 150 : (aux1 == 175 ? 175 : (aux1 == 200 ? 200 : (aux1 == 250 ? 250 : (aux1 == 300 ? 300 : (aux1 == 400 ? 400 : (aux1 == 500 ? 500 : (aux1 == 600 ? 600 : (aux1 == 700 ? 700 : (aux1 == 800 ? 800 : (aux1 == 900 ? 900 : (aux1 == 1000 ? 1000 : "")))))))))))))))))));
			aux6 = ((aux2 == 25 ? 19 : (aux2 == 38 ? 38 : (aux2 == 50 ? 50 : (aux2 == 75 ? 75 : (aux2 == 100 ? 100 : (aux2 == 125 ? 125 : (aux2 == 150 ? 150 : (aux2 == 175 ? 175 : (aux2 == 200 ? 200 : (aux2 == 250 ? 250 : (aux2 == 300 ? 300 : (aux2 == 400 ? 400 : (aux2 == 500 ? 500 : (aux2 == 600 ? 600 : (aux2 == 700 ? 700 : (aux2 == 800 ? 800 : (aux2 == 900 ? 900 : (aux2 == 1000 ? 1000 : "")))))))))))))))))));
			aux7 = Elements.Element.GetParameterValueByName(elementos[i], "Tray Width");
			aux8 = Elements.Element.GetParameterValueByName(elementos[i], "Tray Height");
			aux9 = ((aux7 == 25 ? 19 : (aux7 == 38 ? 38 : (aux7 == 50 ? 50 : (aux7 == 75 ? 75 : (aux7 == 100 ? 100 : (aux7 == 125 ? 125 : (aux7 == 150 ? 150 : (aux7 == 175 ? 175 : (aux7 == 200 ? 200 : (aux7 == 250 ? 250 : (aux7 == 300 ? 300 : (aux7 == 400 ? 400 : (aux7 == 500 ? 500 : (aux7 == 600 ? 600 : (aux7 == 700 ? 700 : (aux7 == 800 ? 800 : (aux7 == 900 ? 900 : (aux7 == 1000 ? 1000 : "")))))))))))))))))));
			aux10 = ((aux8 == 25 ? 19 : (aux8 == 38 ? 38 : (aux8 == 50 ? 50 : (aux8 == 75 ? 75 : (aux8 == 100 ? 100 : (aux8 == 125 ? 125 : (aux8 == 150 ? 150 : (aux8 == 175 ? 175 : (aux8 == 200 ? 200 : (aux8 == 250 ? 250 : (aux8 == 300 ? 300 : (aux8 == 400 ? 400 : (aux8 == 500 ? 500 : (aux8 == 600 ? 600 : (aux8 == 700 ? 700 : (aux8 == 800 ? 800 : (aux8 == 900 ? 900 : (aux8 == 1000 ? 1000 : "")))))))))))))))))));
			aux11 = (aux5 != "" && aux6 != "" ? (" - " + aux5 + "x" + aux6 + " mm") : "");
			aux12 = (aux5 != "" && aux6 != "" ? (" - " + aux6 + " mm") : "");
			aux13 = (aux9 != "" && aux10 != "" ? (" - " + aux9 + "x" + aux10 + " mm") : "");
			aux14 = (aux9 != "" && aux10 != "" ? (" - " + aux10 + " mm") : "");
			out1 = (subcategoria == "Perfilado" || subcategoria == "Perfilado_Estrado" ? (aux11 + aux13) : (aux12 + aux14));
			out2 = (instalacao != "" ? (" - " + instalacao) : "");
			descricao = (((descricao_base) + out1) + out2) + ".";
			out = Elements.Element.SetParameterByName(elementos[i], "ID2_Descrição Planilha Quantidades", descricao);
		}
		else
		{
			continue;
		}
	};
	return 0;
};
# ----------------------------------------
código_4 = CodeBlock(elementos=all_elements_of_category_4)
# ---------- código_4.designscript (21 lines) ----------
elementos_tipo = Elements.Element.ElementType(elementos);
rotina = Elements.Element.GetParameterValueByName(elementos_tipo, "ITC_Dynamo");
[Imperative]
{
	for (i in 0..(List.Count(rotina)-1))
	{
		if (rotina[i] == "Dy_PlanilhaBusway")
		{
			aux1 = Elements.Element.GetParameterValueByName(elementos_tipo[i], "ID2_Código EAP");
			aux2 = Elements.Element.GetParameterValueByName(elementos[i], "ID2_Código Sufixo");
			aux3 = ((aux2 != "" ? ("." + aux2) : ""));
			codigo = (aux1 + aux3);
			out = Elements.Element.SetParameterByName(elementos[i], "ID2_Código", codigo);
		}
		else
		{
			continue;
		}
	};
	return 0;
};
# ----------------------------------------
