# Dynamo graph Dy_PlanilhaEletroduto.dyn (Dynamo 2.13.1.3887)

categories = Categories("OST_Conduit")
all_elements_of_category = ElementsOfCategory(Category=categories)

# group: SEGMENTO DE ELETRODUTO
descricao_planilha_de = CodeBlock(elementos=all_elements_of_category)  # "Descricao Planilha de Qunatidades"
# ---------- descricao_planilha_de.designscript (23 lines) ----------
elementos_tipo = Elements.Element.ElementType(elementos);
categoria = Elements.Element.GetParameterValueByName(elementos_tipo, "ITC_Dynamo");
[Imperative]
{
	for (i in 0..(List.Count(categoria)-1))
	{
		if (categoria[i] == "Eletroduto")
		{
			descricao_base = Elements.Element.GetParameterValueByName(elementos_tipo[i], "ID_Descrição");
			aux1 = Elements.Element.GetParameterValueByName(elementos[i], "Tamanho");
			aux2 = Elements.Element.GetParameterValueByName(elementos[i], "ITC_Instalação");
			out1 = ((aux1 == "16ø" ? "1/2 polegada" : (aux1 == "20ø" ? "3/4 polegada" : (aux1 == "25ø" ? "1 polegada" : (aux1 == "32ø" ? "1 1/4 polegada" : (aux1 == "40ø" ? "1 1/2 polegada" : (aux1 == "50ø" ? "2 polegadas" : (aux1 == "75ø" ? "2 1/2 polegadas" : (aux1 == "85ø" ? "3 polegadas" : (aux1 == "110ø" ? "4 polegadas" : "verificar a seção no projeto"))))))))));
			out2 = (aux2 == "" ? "" : " - " + aux2);
			descricao = ((descricao_base + " - ") + out1) + out2;
			out = Elements.Element.SetParameterByName(elementos[i], "ID_Descrição Planilha Quantidades", descricao);
		}
		else
		{
			continue;
		}
	};
	return 0;
};
# ----------------------------------------
código = CodeBlock(elementos=all_elements_of_category)
# ---------- código.designscript (22 lines) ----------
elementos_tipo = Elements.Element.ElementType(elementos);
categoria = Elements.Element.GetParameterValueByName(elementos_tipo, "ITC_Dynamo");
[Imperative]
{
	for (i in 0..(List.Count(categoria)-1))
	{
		if (categoria[i] == "Eletroduto")
		{
			codigo_eap = Elements.Element.GetParameterValueByName(elementos_tipo[i], "ID_Código EAP");
			codigo_sufixo = Elements.Element.GetParameterValueByName(elementos[i], "ID_Código Sufixo");
			aux1 = codigo_eap;
			aux2 = ((codigo_sufixo != "" ? ("." + codigo_sufixo) : ""));
			codigo = (aux1 + aux2);
			out = Elements.Element.SetParameterByName(elementos[i], "ID_Código", codigo);
		}
		else
		{
			continue;
		}
	};
	return 0;
};
# ----------------------------------------

categories_2 = Categories("OST_ConduitFitting")
all_elements_of_category_2 = ElementsOfCategory(Category=categories_2)

# group: CONEXÃO DE ELETRODUTO
código_2 = CodeBlock(elementos=all_elements_of_category_2)
# ---------- código_2.designscript (22 lines) ----------
elementos_tipo = Elements.Element.ElementType(elementos);
categoria = Elements.Element.GetParameterValueByName(elementos_tipo, "ITC_Dynamo");
[Imperative]
{
	for (i in 0..(List.Count(categoria)-1))
	{
		if (categoria[i] == "Conexao_eletroduto")
		{
			codigo_eap = Elements.Element.GetParameterValueByName(elementos_tipo[i], "ID_Código EAP");
			codigo_sufixo = Elements.Element.GetParameterValueByName(elementos[i], "ID_Código Sufixo");
			aux1 = codigo_eap;
			aux2 = ((codigo_sufixo != "" ? ("." + codigo_sufixo) : ""));
			codigo = (aux1 + aux2);
			escreve = Elements.Element.SetParameterByName(elementos[i], "ID_Código", codigo);
		}
		else
		{
			continue;
		}
	};
	return 0;
};
# ----------------------------------------
code_block = CodeBlock(elementos=all_elements_of_category_2)
# ---------- code_block.designscript (26 lines) ----------
elementos_tipo = Elements.Element.ElementType(elementos);
categoria = Elements.Element.GetParameterValueByName(elementos_tipo, "ITC_Dynamo");
[Imperative]
{
	for (i in 0..(List.Count(categoria)-1))
	{
		if (categoria[i] == "Conexao_eletroduto")
		{
			descricao_base = Elements.Element.GetParameterValueByName(elementos_tipo[i], "ID_Descrição");
			subcategoria = Elements.Element.GetParameterValueByName(elementos_tipo[i], "ITC_Subcategoria");
			aux3 = Elements.Element.GetParameterValueByName(elementos[i], "ITC_Instalação");
			aux2 = Elements.Element.GetParameterValueByName(elementos[i], "Tamanho");
			aux1 = Elements.Element.GetParameterValueByName(elementos[i], "Ângulo");
			out1 = (((aux1 > 89) && (aux1 < 91) ? "90°" : ((aux1 > 44) && (aux1 < 46) ? "45°" : "verificar")));
			out2 = ((aux2 == "16øx16ø" || aux2 == "16ø" || aux2 == "16øx16øx16ø" || aux2 == "16øx16øx16øx16ø" ? "1/2 polegada" : (aux2 == "20øx20ø" || aux2 == "20ø" || aux2 == "20øx20øx20ø" || aux2 == "20øx20øx20øx20ø" ? "3/4 polegada" : (aux2 == "25øx25ø" || aux2 == "25ø" || aux2 == "25øx25øx25ø" || aux2 == "25øx25øx25øx25ø" ? "1 polegada" : (aux2 == "32øx32ø" || aux2 == "32ø" || aux2 == "32øx32øx32ø" || aux2 == "32øx32øx32øx32ø" ? "1 1/4 polegada" : (aux2 == "40øx40ø" || aux2 == "40ø" || aux2 == "40øx40øx40ø" || aux2 == "40øx40øx40øx40ø" ? "1 1/2 polegada" : (aux2 == "50øx50ø"  || aux2 == "50ø" || aux2 == "50øx50øx50ø" || aux2 == "50øx50øx50øx50ø" ? "2 polegadas" : (aux2 == "75øx75ø"  || aux2 == "75ø" || aux2 == "75øx75øx75ø" || aux2 == "75øx75øx75øx75ø" ? "2 1/2 polegadas" : (aux2 == "85øx85ø"  || aux2 == "85ø" || aux2 == "85øx85øx85ø" || aux2 == "85øx85øx85øx85ø" ? "3 polegadas" : (aux2 == "110øx110ø"  || aux2 == "110ø"  || aux2 == "110øx110øx110ø" || aux2 == "110øx110øx110øx110ø"? "4 polegadas" : "verificar a seção no projeto"))))))))));
			out3 = ((aux3 == "" ? "" : " - " + aux3));
			descricao = (subcategoria == "Condulete" ? ((descricao_base + " - ") + out2) + out3 : ((((descricao_base + " - ") + out1) + " - ") + out2) + out3);
			escreve = Elements.Element.SetParameterByName(elementos[i], "ID_Descrição Planilha Quantidades", descricao);
		}
		else
		{
			continue;
		}
	};
	return 0;
};
# ----------------------------------------

# group: LUVA PARA CONEXÃO DE ELETRODUTO
code_block_2 = CodeBlock(elementos=all_elements_of_category_2)
# ---------- code_block_2.designscript (23 lines) ----------
elementos_tipo = Elements.Element.ElementType(elementos);
categoria = Elements.Element.GetParameterValueByName(elementos_tipo, "ITC_Dynamo");
[Imperative]
{
	for (i in 0..(List.Count(categoria)-1))
	{
		if (categoria[i] == "Conexao_eletroduto")
		{
			descricao_base = Elements.Element.GetParameterValueByName(elementos_tipo[i], "ID2_Descrição");
			aux1 = Elements.Element.GetParameterValueByName(elementos[i], "Raio nominal");
			aux2 = Elements.Element.GetParameterValueByName(elementos[i], "ITC_Instalação");
			out1 = ((aux1 == 8 ? "1/2 polegada" : (aux1 == 10 ? "3/4 polegada" : (aux1 == 12.5 ? "1 polegada" : (aux1 == 16 ? "1 1/4 polegada" : (aux1 == 20 ? "1 1/2 polegada" : (aux1 == 25 ? "2 polegadas" : (aux1 == 37.5 ? "2 1/2 polegadas" : (aux1 == 42.5 ? "3 polegadas" : (aux1 == 55 ? "4 polegadas" : "verificar a seção no projeto"))))))))));
			out2 = (aux2 == "" ? "" : " - " + aux2);
			descricao = ((descricao_base + " - ") + out1) + out2;
			out = Elements.Element.SetParameterByName(elementos[i], "ID2_Descrição Planilha Quantidades", descricao);
		}
		else
		{
			continue;
		}
	};
	return 0;
};
# ----------------------------------------
código_3 = CodeBlock(elementos=all_elements_of_category_2)
# ---------- código_3.designscript (22 lines) ----------
elementos_tipo = Elements.Element.ElementType(elementos);
categoria = Elements.Element.GetParameterValueByName(elementos_tipo, "ITC_Dynamo");
[Imperative]
{
	for (i in 0..(List.Count(categoria)-1))
	{
		if (categoria[i] == "Conexao_eletroduto")
		{
			codigo_eap = Elements.Element.GetParameterValueByName(elementos_tipo[i], "ID2_Código EAP");
			codigo_sufixo = Elements.Element.GetParameterValueByName(elementos[i], "ID2_Código Sufixo");
			aux1 = codigo_eap;
			aux2 = ((codigo_sufixo != "" ? ("." + codigo_sufixo) : ""));
			codigo = (aux1 + aux2);
			escreve = Elements.Element.SetParameterByName(elementos[i], "ID2_Código", codigo);
		}
		else
		{
			continue;
		}
	};
	return 0;
};
# ----------------------------------------
quantidade = CodeBlock(elementos=all_elements_of_category_2)
# ---------- quantidade.designscript (18 lines) ----------
elementos_tipo = Elements.Element.ElementType(elementos);
categoria = Elements.Element.GetParameterValueByName(elementos_tipo, "ITC_Dynamo");
[Imperative]
{
	for (i in 0..(List.Count(categoria)-1))
	{
		if (categoria[i] == "Conexao_eletroduto")
		{
			aux1 = Elements.Element.GetParameterValueByName(elementos_tipo[i], "PROJ_Quantidade Fixa de Luva");
			out = Elements.Element.SetParameterByName(elementos[i], "PROJ_Quantidade de luva", aux1);
		}
		else
		{
			continue;
		}
	};
	return 0;
};
# ----------------------------------------

# group: LUVA DE SEGMENTO DE ELETRODUTO
quantidade_2 = CodeBlock(elementos=all_elements_of_category)
# ---------- quantidade_2.designscript (21 lines) ----------
elementos_tipo = Elements.Element.ElementType(elementos);
categoria = Elements.Element.GetParameterValueByName(elementos_tipo, "ITC_Dynamo");
[Imperative]
{
	for (i in 0..(List.Count(categoria)-1))
	{
		if (categoria[i] == "Eletroduto")
		{
			aux1 = Elements.Element.GetParameterValueByName(elementos[i], "Comprimento");
			aux2 = (aux1 <= 3000 ? 0 : (aux1 / 3000) - 0.499999999);
			//aux2 = (aux1 <= 3 ? 0 : (aux1 > 3 && aux1 < 50 ? aux1 / 3.00001 : (aux1 > 3000 ? aux1 / 3000.00001: 0)));
			quantidade_luvas = Math.Floor(aux2);
			out = Elements.Element.SetParameterByName(elementos[i], "PROJ_Quantidade de luva", quantidade_luvas);
		}
		else
		{
			continue;
		}
	};
	return 0;
};
# ----------------------------------------
código_4 = CodeBlock(elementos=all_elements_of_category)
# ---------- código_4.designscript (22 lines) ----------
elementos_tipo = Elements.Element.ElementType(elementos);
categoria = Elements.Element.GetParameterValueByName(elementos_tipo, "ITC_Dynamo");
[Imperative]
{
	for (i in 0..(List.Count(categoria)-1))
	{
		if (categoria[i] == "Eletroduto")
		{
			codigo_eap = Elements.Element.GetParameterValueByName(elementos_tipo[i], "ID2_Código EAP");
			codigo_sufixo = Elements.Element.GetParameterValueByName(elementos[i], "ID2_Código Sufixo");
			aux1 = codigo_eap;
			aux2 = ((codigo_sufixo != "" ? ("." + codigo_sufixo) : ""));
			codigo = (aux1 + aux2);
			out = Elements.Element.SetParameterByName(elementos[i], "ID2_Código", codigo);
		}
		else
		{
			continue;
		}
	};
	return 0;
};
# ----------------------------------------
descricao_planilha_de_2 = CodeBlock(elementos=all_elements_of_category)  # "Descricao Planilha de Qunatidades"
# ---------- descricao_planilha_de_2.designscript (23 lines) ----------
elementos_tipo = Elements.Element.ElementType(elementos);
categoria = Elements.Element.GetParameterValueByName(elementos_tipo, "ITC_Dynamo");
[Imperative]
{
	for (i in 0..(List.Count(categoria)-1))
	{
		if (categoria[i] == "Eletroduto")
		{
			descricao_base = Elements.Element.GetParameterValueByName(elementos_tipo[i], "ID2_Descrição");
			aux1 = Elements.Element.GetParameterValueByName(elementos[i], "Tamanho");
			aux2 = Elements.Element.GetParameterValueByName(elementos[i], "ITC_Instalação");
			out1 = ((aux1 == "16ø" ? "1/2 polegada" : (aux1 == "20ø" ? "3/4 polegada" : (aux1 == "25ø" ? "1 polegada" : (aux1 == "32ø" ? "1 1/4 polegada" : (aux1 == "40ø" ? "1 1/2 polegada" : (aux1 == "50ø" ? "2 polegadas" : (aux1 == "75ø" ? "2 1/2 polegadas" : (aux1 == "85ø" ? "3 polegadas" : (aux1 == "110ø" ? "4 polegadas" : "verificar a seção no projeto"))))))))));
			out2 = (aux2 == "" ? "" : " - " + aux2);
			descricao = ((descricao_base + " - ") + out1) + out2;
			out = Elements.Element.SetParameterByName(elementos[i], "ID2_Descrição Planilha Quantidades", descricao);
		}
		else
		{
			continue;
		}
	};
	return 0;
};
# ----------------------------------------

code_block_3 = CodeBlock()
# ---------- code_block_3.designscript (28 lines) ----------
/*

ATENÇÃO: Unidade de comprimento linear em milímetros !!!!

preenche:

- ID_Descrição Planilha Quantidades
- ID_Código
- ID_Quantidade de luva
- ID2_Descrição Planilha Quantidades
- ID2_Código

dos itens abaixo:

- ELE - ELETRODUTO RÍGIDO DE AÇO
- ELE - ELETRODUTO RÍGIDO DE PVC
- ELE - ELETRODUTO RÍGIDO À PROVA DE EXPLOSÃO
- ELE - ELETRODUTO METÁLICO FLEXÍVEL À PROVA DE EXPLOSÃO
- ELE - ELETRODUTO METÁLICO FLEXÍVEL À PROVA DE TEMPO
- CNX - ELETRODUTO BSB - CONDULETE ALUMÍNIO - TIPO LR
- CNX - ELETRODUTO BSB - CONDULETE ALUMÍNIO - TIPO T
- CNX - ELETRODUTO BSB - CONDULETE ALUMÍNIO - TIPO C
- CNX - ELETRODUTO NPT - CONDULETE ALUMÍNIO - TIPO LR
- CNX - ELETRODUTO NPT - CONDULETE ALUMÍNIO - TIPO T
- CNX - ELETRODUTO NPT - CONDULETE ALUMÍNIO - TIPO C
- CNX - ELTRODUTO - CURVA CURTA - PVC

*/;
# ----------------------------------------
