# Dynamo graph Dy_PlanilhaEquipamentos.dyn (Dynamo 2.13.1.3887)

# group: Equipamentos
categories = Categories("OST_ElectricalEquipment")
all_elements_of_category = ElementsOfCategory(Category=categories)
código = CodeBlock(elementos=all_elements_of_category)
# ---------- código.designscript (6 lines) ----------
elementos_tipo = Elements.Element.ElementType(elementos);
aux1 = Elements.Element.GetParameterValueByName(elementos_tipo, "ID_Código EAP");
aux2 = Elements.Element.GetParameterValueByName(elementos, "ID_Código Sufixo");
aux3 = ((aux2 != "" ? ("." + aux2) : ""));
codigo = (aux1 + aux3);
out = Elements.Element.SetParameterByName(elementos, "ID_Código", codigo);
# ----------------------------------------
descricao_planilha_de = CodeBlock()  # "Descricao Planilha de Qunatidades"; unwired: elementos
# ---------- descricao_planilha_de.designscript (5 lines) ----------
elementos_tipo = Elements.Element.ElementType(elementos);
descricao_base = Elements.Element.GetParameterValueByName(elementos, "ID_Descrição");
tag = Elements.Element.GetParameterValueByName(elementos, "PROJ_EQP_TAG");
descricao = (descricao_base + " - ") + tag;
out = Elements.Element.SetParameterByName(elementos, "ID_Descrição Planilha Quantidades", descricao);
# ----------------------------------------
especificação = CodeBlock(elementos=all_elements_of_category)  # unwired: notas
# ---------- especificação.designscript (6 lines) ----------
elementos_tipo = Elements.Element.ElementType(elementos);
aux1 = Elements.Element.GetParameterValueByName(elementos_tipo, "ESP_Especificação Geral");
aux2 = Elements.Element.GetParameterValueByName(elementos_tipo, "ESP_Notas Gerais");
aux3 = Elements.Element.GetParameterValueByName(elementos_tipo, "ESP_Referência de Fabricante");
especificacao_completa = (notas == "" ? ((aux1 + " \n") + aux3) + "." : ((((aux1 + " \n") + aux2) + " \n") + aux3) + ".");
out = Elements.Element.SetParameterByName(elementos, "ID_Especificação", especificacao_completa);
# ----------------------------------------

nome_da_família = CodeBlock { "EQP - ELE - TRAFO"; }
nome_do_tipo = CodeBlock { "EQP - ELE - TRAFO - 13,8/0,38 kV (delta/Y) - 2000 kVA"; }
byFamilyNameAndTypeName = FamilyType.ByFamilyNameAndTypeName(familyName=nome_da_família, typeName=nome_do_tipo)
nome_do_tipo_2 = CodeBlock { "EQP - ELE - TRAFO - 4,16/0,38 kV (delta/Y) - 500 kVA"; }
byFamilyNameAndTypeName_2 = FamilyType.ByFamilyNameAndTypeName(familyName=nome_da_família, typeName=nome_do_tipo_2)
agrupa_os_tipos = CodeBlock(A=byFamilyNameAndTypeName, B=byFamilyNameAndTypeName_2) { [A,B]; }
all_elements_of_family_type = ElementsOfFamilyType(Family_Type=agrupa_os_tipos)
descricao_planilha_de_2 = CodeBlock(elementos=all_elements_of_family_type)  # "Descricao Planilha de Qunatidades"
# ---------- descricao_planilha_de_2.designscript (10 lines) ----------
elementos_tipo = Elements.Element.ElementType(elementos);
descricao_base = Elements.Element.GetParameterValueByName(elementos, "ID_Descrição");
tag = Elements.Element.GetParameterValueByName(elementos, "PROJ_EQP_TAG");
pot = Elements.Element.GetParameterValueByName(elementos, "ESP_Potência Nominal");
tensao_primaria = Elements.Element.GetParameterValueByName(elementos, "ESP_Tensão de Operação Primária");
tensao_secundaria = Elements.Element.GetParameterValueByName(elementos, "ESP_Tensão de Operação Secundária");
aux_desenho = Elements.Element.GetParameterValueByName(elementos, "ESP_Desenho de Referência");
desenho = (aux_desenho != "" ? " - Conforme desenho: " + aux_desenho : " - Conforme projeto.");
descricao = (((((descricao_base + " - ") + tag) + " - " + pot) + " - " + tensao_primaria) + " - " + tensao_secundaria) + desenho;
out = Elements.Element.SetParameterByName(elementos, "ID_Descrição Planilha Quantidades", descricao);
# ----------------------------------------
nome_da_família_2 = CodeBlock { "EQP - ELE - PMT"; }
nome_do_tipo_3 = CodeBlock { "EQP - ELE - PAINEL DE MÉDIA TENSÃO DE PROTEÇÃO, COM DISJUNTOR - 13,8 kV"; }
byFamilyNameAndTypeName_3 = FamilyType.ByFamilyNameAndTypeName(familyName=nome_da_família_2, typeName=nome_do_tipo_3)
nome_do_tipo_4 = CodeBlock { "EQP - ELE - PAINEL DE MÉDIA TENSÃO DE PROTEÇÃO, COM DISJUNTOR - 4,16 kV"; }
byFamilyNameAndTypeName_4 = FamilyType.ByFamilyNameAndTypeName(familyName=nome_da_família_2, typeName=nome_do_tipo_4)
agrupa_os_tipos_2 = CodeBlock(A=byFamilyNameAndTypeName_3, B=byFamilyNameAndTypeName_4) { [A,B]; }
all_elements_of_family_type_2 = ElementsOfFamilyType(Family_Type=agrupa_os_tipos_2)
descricao_planilha_de_3 = CodeBlock(elementos=all_elements_of_family_type_2)  # "Descricao Planilha de Qunatidades"
# ---------- descricao_planilha_de_3.designscript (8 lines) ----------
elementos_tipo = Elements.Element.ElementType(elementos);
descricao_base = Elements.Element.GetParameterValueByName(elementos, "ID_Descrição");
tag = Elements.Element.GetParameterValueByName(elementos, "PROJ_EQP_TAG");
tensao = Elements.Element.GetParameterValueByName(elementos, "ESP_Tensão Nominal (Classe)");
aux_desenho = Elements.Element.GetParameterValueByName(elementos, "ESP_Desenho de Referência");
desenho = (aux_desenho != "" ? " - Conforme desenho: " + aux_desenho : " - Conforme projeto.");
descricao = (((descricao_base + " - ") + tag) + " - " + tensao) + desenho;
out = Elements.Element.SetParameterByName(elementos, "ID_Descrição Planilha Quantidades", descricao);
# ----------------------------------------
nome_da_família_3 = CodeBlock { "EQP - ELE - PTA"; }
nome_do_tipo_5 = CodeBlock { "EQP - ELE - PAINEL DE TRANSFERÊNCIA AUTOMÁTICA"; }
byFamilyNameAndTypeName_5 = FamilyType.ByFamilyNameAndTypeName(familyName=nome_da_família_3, typeName=nome_do_tipo_5)
all_elements_of_family_type_3 = ElementsOfFamilyType(Family_Type=byFamilyNameAndTypeName_5)
descricao_planilha_de_4 = CodeBlock(elementos=all_elements_of_family_type_3)  # "Descricao Planilha de Qunatidades"
# ---------- descricao_planilha_de_4.designscript (8 lines) ----------
elementos_tipo = Elements.Element.ElementType(elementos);
descricao_base = Elements.Element.GetParameterValueByName(elementos, "ID_Descrição");
tag = Elements.Element.GetParameterValueByName(elementos, "PROJ_EQP_TAG");
corrente = Elements.Element.GetParameterValueByName(elementos, "ESP_Barramento");
aux_desenho = Elements.Element.GetParameterValueByName(elementos, "ESP_Desenho de Referência");
desenho = (aux_desenho != "" ? " - Conforme desenho: " + aux_desenho : " - Conforme projeto.");
descricao = (((descricao_base + " - ") + tag) + " - " + corrente) + desenho;
out = Elements.Element.SetParameterByName(elementos, "ID_Descrição Planilha Quantidades", descricao);
# ----------------------------------------
nome_da_família_4 = CodeBlock { "EQP - ELE - GMG 2"; }
nome_do_tipo_6 = CodeBlock { "Standard"; }
byFamilyNameAndTypeName_6 = FamilyType.ByFamilyNameAndTypeName(familyName=nome_da_família_4, typeName=nome_do_tipo_6)
all_elements_of_family_type_4 = ElementsOfFamilyType(Family_Type=byFamilyNameAndTypeName_6)
descricao_planilha_de_5 = CodeBlock(elementos=all_elements_of_family_type_4)  # "Descricao Planilha de Qunatidades"
# ---------- descricao_planilha_de_5.designscript (9 lines) ----------
elementos_tipo = Elements.Element.ElementType(elementos);
descricao_base = Elements.Element.GetParameterValueByName(elementos, "ID_Descrição");
tag = Elements.Element.GetParameterValueByName(elementos, "PROJ_EQP_TAG");
pot = Elements.Element.GetParameterValueByName(elementos, "ESP_Potência Nominal");
tensao = Elements.Element.GetParameterValueByName(elementos, "ESP_Tensão de Operação");
aux_desenho = Elements.Element.GetParameterValueByName(elementos, "ESP_Desenho de Referência");
desenho = (aux_desenho != "" ? " - Conforme desenho: " + aux_desenho : " - Conforme projeto.");
descricao = ((((descricao_base + " - ") + tag) + " - " + pot) + " - " + tensao) + desenho;
out = Elements.Element.SetParameterByName(elementos, "ID_Descrição Planilha Quantidades", descricao);
# ----------------------------------------
nome_da_família_5 = CodeBlock { "EQP - ELE - URF"; }
nome_do_tipo_7 = CodeBlock { "EQP - ELE - UNIDADE RETIFICADORA MODULAR, 12 PULSOS"; }
byFamilyNameAndTypeName_7 = FamilyType.ByFamilyNameAndTypeName(familyName=nome_da_família_5, typeName=nome_do_tipo_7)
all_elements_of_family_type_5 = ElementsOfFamilyType(Family_Type=byFamilyNameAndTypeName_7)
descricao_planilha_de_6 = CodeBlock(elementos=all_elements_of_family_type_5)  # "Descricao Planilha de Qunatidades"
# ---------- descricao_planilha_de_6.designscript (9 lines) ----------
elementos_tipo = Elements.Element.ElementType(elementos);
descricao_base = Elements.Element.GetParameterValueByName(elementos, "ID_Descrição");
tag = Elements.Element.GetParameterValueByName(elementos, "PROJ_EQP_TAG");
tensao = Elements.Element.GetParameterValueByName(elementos, "ESP_Tensão de Saída");
corrente = Elements.Element.GetParameterValueByName(elementos, "ESP_Corrente de Saída");
aux_desenho = Elements.Element.GetParameterValueByName(elementos, "ESP_Desenho de Referência");
desenho = (aux_desenho != "" ? " - Conforme desenho: " + aux_desenho : " - Conforme projeto.");
descricao = ((((descricao_base + " - ") + tag) + " - " + tensao) + " - " + corrente) + desenho;
out = Elements.Element.SetParameterByName(elementos, "ID_Descrição Planilha Quantidades", descricao);
# ----------------------------------------
nome_da_família_6 = CodeBlock { "EQP - ELE - BATERIA VRLA"; }
nome_do_tipo_8 = CodeBlock { "EQP - ELE - BATERIA ESTACIONÁRIA REGULADA POR VÁLVULA"; }
byFamilyNameAndTypeName_8 = FamilyType.ByFamilyNameAndTypeName(familyName=nome_da_família_6, typeName=nome_do_tipo_8)
all_elements_of_family_type_6 = ElementsOfFamilyType(Family_Type=byFamilyNameAndTypeName_8)
descricao_planilha_de_7 = CodeBlock(elementos=all_elements_of_family_type_6)  # "Descricao Planilha de Qunatidades"
# ---------- descricao_planilha_de_7.designscript (9 lines) ----------
elementos_tipo = Elements.Element.ElementType(elementos);
descricao_base = Elements.Element.GetParameterValueByName(elementos, "ID_Descrição");
tag = Elements.Element.GetParameterValueByName(elementos, "PROJ_EQP_TAG");
pot = Elements.Element.GetParameterValueByName(elementos, "ESP_Potência Nominal");
autonomia = Elements.Element.GetParameterValueByName(elementos, "ESP_Autonomia");
aux_desenho = Elements.Element.GetParameterValueByName(elementos, "ESP_Desenho de Referência");
desenho = (aux_desenho != "" ? " - Conforme desenho: " + aux_desenho : " - Conforme projeto.");
descricao = ((((descricao_base + " - ") + tag) + " - " + pot) + " - " + autonomia) + desenho;
out = Elements.Element.SetParameterByName(elementos, "ID_Descrição Planilha Quantidades", descricao);
# ----------------------------------------
nome_da_família_7 = CodeBlock { "EQP - ELE - BC"; }
nome_do_tipo_9 = CodeBlock { "EQP - ELE - BANCO DE CAPACITORES"; }
byFamilyNameAndTypeName_9 = FamilyType.ByFamilyNameAndTypeName(familyName=nome_da_família_7, typeName=nome_do_tipo_9)
all_elements_of_family_type_7 = ElementsOfFamilyType(Family_Type=byFamilyNameAndTypeName_9)
descricao_planilha_de_8 = CodeBlock(elementos=all_elements_of_family_type_7)  # "Descricao Planilha de Qunatidades"; same code as descricao_planilha_de_5
nome_da_família_8 = CodeBlock { "EQP - ELE - CHE"; }
nome_do_tipo_10 = CodeBlock { "EQP - ELE - CHAVE ESTÁTICA DE TRANSFERÊNCIA AUTOMÁTICA"; }
byFamilyNameAndTypeName_10 = FamilyType.ByFamilyNameAndTypeName(familyName=nome_da_família_8, typeName=nome_do_tipo_10)
all_elements_of_family_type_8 = ElementsOfFamilyType(Family_Type=byFamilyNameAndTypeName_10)
descricao_planilha_de_9 = CodeBlock(elementos=all_elements_of_family_type_8)  # "Descricao Planilha de Qunatidades"
# ---------- descricao_planilha_de_9.designscript (8 lines) ----------
elementos_tipo = Elements.Element.ElementType(elementos);
descricao_base = Elements.Element.GetParameterValueByName(elementos, "ID_Descrição");
tag = Elements.Element.GetParameterValueByName(elementos, "PROJ_EQP_TAG");
corrente = Elements.Element.GetParameterValueByName(elementos, "ESP_Corrente de Saída");
aux_desenho = Elements.Element.GetParameterValueByName(elementos, "ESP_Desenho de Referência");
desenho = (aux_desenho != "" ? " - Conforme desenho: " + aux_desenho : " - Conforme projeto.");
descricao = (((descricao_base + " - ") + tag) + " - " + corrente) + desenho;
out = Elements.Element.SetParameterByName(elementos, "ID_Descrição Planilha Quantidades", descricao);
# ----------------------------------------
nome_da_família_9 = CodeBlock { "EQP - ELE - PBT"; }
nome_do_tipo_11 = CodeBlock { "EQP - ELE - PAINEL DE DISTRIBUIÇÃO EM BAIXA TENSÃO"; }
byFamilyNameAndTypeName_11 = FamilyType.ByFamilyNameAndTypeName(familyName=nome_da_família_9, typeName=nome_do_tipo_11)
all_elements_of_family_type_9 = ElementsOfFamilyType(Family_Type=byFamilyNameAndTypeName_11)
descricao_planilha_de_10 = CodeBlock(elementos=all_elements_of_family_type_9)  # "Descricao Planilha de Qunatidades"; same code as descricao_planilha_de_4
nome_da_família_10 = CodeBlock { "EQP - ELE - QGBT"; }
nome_do_tipo_12 = CodeBlock { "EQP - ELE - QUADRO GERAL DE BAIXA TENSÃO"; }
byFamilyNameAndTypeName_12 = FamilyType.ByFamilyNameAndTypeName(familyName=nome_da_família_10, typeName=nome_do_tipo_12)
nome_da_família_11 = CodeBlock { "EQP - ELE - QDFL"; }
nome_do_tipo_13 = CodeBlock { "EQP - ELE - QUADRO DE DISTRIBUIÇÃO DE FORÇA E LUZ"; }
byFamilyNameAndTypeName_13 = FamilyType.ByFamilyNameAndTypeName(familyName=nome_da_família_11, typeName=nome_do_tipo_13)
nome_da_família_12 = CodeBlock { "EQP - ELE - QDL"; }
nome_do_tipo_14 = CodeBlock { "EQP - ELE - QUADRO DE DISTRIBUIÇÃO DE LUZ"; }
byFamilyNameAndTypeName_14 = FamilyType.ByFamilyNameAndTypeName(familyName=nome_da_família_12, typeName=nome_do_tipo_14)
nome_da_família_13 = CodeBlock { "EQP - ELE - QCM"; }
nome_do_tipo_15 = CodeBlock { "EQP - ELE - QUADRO DE FORÇA E COMANDO DE MOTOR-BOMBA"; }
byFamilyNameAndTypeName_15 = FamilyType.ByFamilyNameAndTypeName(familyName=nome_da_família_13, typeName=nome_do_tipo_15)
nome_da_família_14 = CodeBlock { "EQP - ELE - QDCC"; }
nome_do_tipo_16 = CodeBlock { "EQP - ELE - QUADRO DE DISTRIBUIÇÃO DE CORRENTE CONTÍNUA"; }
byFamilyNameAndTypeName_16 = FamilyType.ByFamilyNameAndTypeName(familyName=nome_da_família_14, typeName=nome_do_tipo_16)
agrupa_os_tipos_3 = CodeBlock(A=byFamilyNameAndTypeName_12, B=byFamilyNameAndTypeName_13, C=byFamilyNameAndTypeName_14, D=byFamilyNameAndTypeName_15, E=byFamilyNameAndTypeName_16) { [A,B,C,D,E]; }
all_elements_of_family_type_10 = ElementsOfFamilyType(Family_Type=agrupa_os_tipos_3)
descricao_planilha_de_11 = CodeBlock(elementos=all_elements_of_family_type_10)  # "Descricao Planilha de Qunatidades"
# ---------- descricao_planilha_de_11.designscript (7 lines) ----------
elementos_tipo = Elements.Element.ElementType(elementos);
descricao_base = Elements.Element.GetParameterValueByName(elementos, "ID_Descrição");
tag = Elements.Element.GetParameterValueByName(elementos, "PROJ_EQP_TAG");
aux_desenho = Elements.Element.GetParameterValueByName(elementos, "ESP_Desenho de Referência");
desenho = (aux_desenho != "" ? " - Conforme desenho: " + aux_desenho : " - Conforme projeto.");
descricao = ((descricao_base + " - ") + tag) + desenho;
out = Elements.Element.SetParameterByName(elementos, "ID_Descrição Planilha Quantidades", descricao);
# ----------------------------------------
nome_da_família_15 = CodeBlock { "EQP - ELE - UPS"; }
nome_do_tipo_17 = CodeBlock { "EQP - ELE - SISTEMA ININTERRUPTO DE ENERGIA ESTÁTICA MODULAR"; }
byFamilyNameAndTypeName_17 = FamilyType.ByFamilyNameAndTypeName(familyName=nome_da_família_15, typeName=nome_do_tipo_17)
all_elements_of_family_type_11 = ElementsOfFamilyType(Family_Type=byFamilyNameAndTypeName_17)
descricao_planilha_de_12 = CodeBlock(elementos=all_elements_of_family_type_11)  # "Descricao Planilha de Qunatidades"
# ---------- descricao_planilha_de_12.designscript (10 lines) ----------
elementos_tipo = Elements.Element.ElementType(elementos);
descricao_base = Elements.Element.GetParameterValueByName(elementos, "ID_Descrição");
tag = Elements.Element.GetParameterValueByName(elementos, "PROJ_EQP_TAG");
tensao = Elements.Element.GetParameterValueByName(elementos, "ESP_Tensão de Operação");
configuracao = Elements.Element.GetParameterValueByName(elementos, "ESP_Configuração");
potencia = Elements.Element.GetParameterValueByName(elementos, "ESP_Potência por Módulo");
aux_desenho = Elements.Element.GetParameterValueByName(elementos, "ESP_Desenho de Referência");
desenho = (aux_desenho != "" ? " - Conforme desenho: " + aux_desenho : " - Conforme projeto.");
descricao = ((((descricao_base + " - ") + tag) + " - " + tensao) + " - " + "Configuração: " + configuracao + " (" + potencia + " cada módulo)") + desenho;
out = Elements.Element.SetParameterByName(elementos, "ID_Descrição Planilha Quantidades", descricao);
# ----------------------------------------
